# Grasshopper definition phdgh.gh (Grasshopper 1.0.7)
# plug-ins: LunchBox

srf = Surface(<surface referenced from the Rhino model>)
number_slider = Slider(0.3, range=0..1.5)
pt = Point(Point(44, -17, 0))
multiplication = Multiplication(A=number_slider, B=Slider(0.7, range=0..1.5))
xy = XYPlane(Origin=pt)
series = Series(Start=Slider(54, range=3..3000), Step=1, Count=Slider(3000, range=3..3000))
hex = HexagonCells(Surface=srf, UDivisions=Slider(32, range=2..40), VDivisions=Slider(11, range=2..40), TParameter=Slider(0.33, range=0..1))  # -> HexagonCells, simplify(graft(Centers))
expression = Expression(x=series, y=number_slider, Expression="sqrt(x)*y")
expression_2 = Expression(x=series, Expression="x*PI*(1+sqrt(5))")
disc = Discontinuity(Curve=hex.HexagonCells, Level=1)  # -> simplify(Points), Parameters
lng = ListLength(List=disc.Points)
equals = Equality(FirstNumber=lng, SecondNumber="6")  # -> flatten(Equality), Inequality
tstat = TreeStatistics(Tree=disc.Points)  # -> Paths, Length, Count
pt_2 = PointCylindrical(BasePlane=xy, Angle=expression_2, Radius=expression, Elevation=0)
cir = Circle(Plane=pt_2, Radius=multiplication)
cull = CullPattern(List=tstat.Paths, CullPattern=equals.Equality)
pt_3 = Point(<point referenced from the Rhino model>)
dist = Distance(PointA=pt_3, PointB=pt_2)
bnd = Bounds(Numbers=dist)
branch = TreeBranch(Tree=simplify(disc.Points), Path=cull, MaintainPaths=False)
branch_2 = TreeBranch(Tree=simplify(hex.Centers), Path=cull, MaintainPaths=False)
remap = RemapNumbers(Value=dist, Source=bnd, Target=Domain(0, 1))  # -> Mapped, Clipped
item = ListItem(List=branch, Index=0, Wrap=True)  # -> Item, Item1, Item2, Item3, Item4, Item5
mateja_dithering = GhPythonScript(P=pt_2, W=remap.Mapped)  # -> out, a; inputs P: list of Point3d, W: list
# ---------- mateja_dithering: Python ----------
"""Provides a scripting component.
    Inputs:
        P: List of Points
        W: List of Weights
        C: Coutnt of neighbours
    Output:
        a: The a output variable"""

__author__ = "qanti"
__version__ = "2019.09.22"

import rhinoscriptsyntax as rs
import Rhino.Geometry as rg
import random

class PW:
    def __init__(self,p,w):
        self.p = p
        self.w = w
    def randomize(r):
        self.w *= random.randrange(1-r,1+r)

# Check empty
if P == [] or W == []:
    """no input yet"""
else:
    # Merge
    if len(P) == len(W):
        pw = []
        for i in xrange(len(P)):
            pw.append(PW(P[i],W[i]))
    else:
        """Nonconsitent length of lists P and W"""
    
    # Shuffle
    pw = random.shuffle(pw)
    
    # Randomize
    for item in pw:
        item.randomize(R)
    
    # Get neighbours
    for item in pw:
        
    ## Set distribution
    
    ## Quantize 
    
    ## Redistribute error
# ---------- end mateja_dithering ----------
merge = Merge(Data1=item.Item2, Data2=item.Item3, Data3=item.Item4, Data4=branch_2)
merge_2 = Merge(Data1=item.Item, Data2=item.Item1, Data3=item.Item2, Data4=branch_2)
merge_3 = Merge(Data1=item.Item4, Data2=item.Item5, Data3=item.Item, Data4=branch_2)
merge_4 = Merge(Data1=item.Item3, Data2=item.Item4, Data3=item.Item5, Data4=branch_2)
pline = PolyLine(Vertices=merge_3, Closed=True)
pline_2 = PolyLine(Vertices=merge_2, Closed=True)
pline_3 = PolyLine(Vertices=merge, Closed=True)
pline_4 = PolyLine(Vertices=merge_4, Closed=True)
merge_5 = Merge(Data1=pline_2, Data2=pline_3, Data3=pline)  # -> flatten(Result)
pcen = PolygonCenter(Polyline=merge_5)  # -> CenterV, CenterE, CenterA
num = Number(Slider(0.82, range=0.1..1))
scale = Scale(Geometry=merge_5, Center=pcen.CenterV, Factor=num)  # -> Geometry, Transform
pt_4 = Point(pcen.CenterV)
crv = Curve(scale.Geometry)
